vi "build_errors.gvi"   [LabVIEW NXG]
inputs:
  "data in": u8[]
outputs:
  "data out": u8[]
panel controls:
  "Error Rate": f64 = 0.5
panel indicators:
  "logical AND": bool
diagram:
  w1 = $"Error Rate"
  for {
    w2 = each element of $"data in"
    Number To Boolean Array(number=w2) -> (Boolean array=w4)
    for {
      w5 = each element of w4
      Random Number() -> (number (0 to 1)=w7)
      Is Greater(x=w7, y=w1) -> w8
      case (w8) {
        frame False, Default {
          w9 = w5
        }
        frame True {
          Not(x=w5) -> w9
        }
      }
      append w9 to w6
    }
    Boolean Array To Number(Boolean array=w6) -> (number=w10: u8)
    append w10 to w3
  }
  $"data out" <- w3
  Is Equal(x=w3, y=$"data in") -> w11
  And Array Elements(Boolean array=w11) -> (logical AND=w12)
  $"logical AND" <- w12
