vi "build_offset.gvi"   [LabVIEW NXG]
inputs:
  "Flipped?": bool
  "split position": u8
  "data in": string
outputs:
  "first data": string
  "first length": i32
  "second data": string
  "second length": i32
diagram:
  To Long Integer(number=$"split position") -> w1
  String Length(string=$"data in") -> (length=w2)
  Subtract(x=w2, y=w1) -> w3
  Select(s=$"Flipped?", t=w3, f=w1) -> w4
  String Subset(length (rest)=w4, offset (0)=0, string=$"data in") -> w5
  $"first data" <- w5
  String Length(string=w5) -> (length=w6)
  $"first length" <- w6
  String Subset(offset (0)=w4, string=$"data in") -> w7
  $"second data" <- w7
  String Length(string=w7) -> (length=w8)
  $"second length" <- w8
