vi "build_pattern.gvi"   [LabVIEW NXG]
inputs:
  "magic head": string = "VLC"
outputs:
  "pattern": string
  "origin length": i32
diagram:
  String Length(string=$"magic head") -> (length=w1)
  $"origin length" <- w1
  Type Cast(type=u8[] [], x=$"magic head") -> w2
  Split 1D Array(array=w2, index=1) -> (first subarray=w3, second subarray=w4)
  Type Cast(type=u8 0, x="?") -> w5
  s1 = u8[] []  # shift register
  for {
    w6 = each element of w4
    Build Array[ConcatenateInputs=True](s1, w6, w5) -> w7
    next s1 = w7
  }
  Build Array[ConcatenateInputs=True](w3, s1) -> w8
  Type Cast(x=w8) -> w9
  $pattern <- w9
