vi "frame_align.gvi"   [LabVIEW NXG]
inputs:
  "magic head": string = "VLC"
  "Input": any
  "magic number": u32 = 449
outputs:
  "Output": any
  "aligned data": u8[]
diagram:
  call "build_pattern.gvi"(magic head=$"magic head") -> (pattern=w1, origin length=w2)
  while {
    Host Fifo Read Node[FifoName="decode fifo up"](FPGA VI Reference In=$Input, Number of Elements=$"magic number", Timeout (ms)=-1) -> (Data=w3, FPGA VI Reference Out=w4)
    Type Cast(x=w3) -> w5
    Match Pattern(regular expression=w1, string=w5) -> (after substring=w6, before substring=w7, match substring=w8)
    String Length(string=w8) -> (length=w9)
    Is Equal(x=w9, y=w2) -> w10
    String Length(string=w6) -> (length=w11)
    Is Equal To 0(x=w11) -> w12
    Logical Or(w10, w12) -> w13
    case (w13) {
      frame False, Default {
        w14 = w4
        w15 = default
        w16 = FALSE
      }
      frame True {
        String Length(string=w7) -> (length=w17)
        Subtract(x=$"magic number", y=w17) -> w18
        Quotient And Remainder(x=w18, y=$"magic number") -> (x-y*floor(x/y)=w19)
        Host Fifo Read Node[FifoName="decode fifo up"](FPGA VI Reference In=w4, Number of Elements=w19, Timeout (ms)=-1) -> (Data=w20, FPGA VI Reference Out=w14)
        Type Cast(x=w20) -> w21
        Concatenate Strings(w8, w6, w21) -> w22
        String Subset(length (rest)=w2, offset (0)=0, string=w22) -> w23
        Is Equal(x=w23, y=$"magic head") -> w24
        case (w24) {
          frame False, Default {
            w15 = default
            w16 = FALSE
          }
          frame True {
            Type Cast(type=u8[] [], x=w22) -> w15
            w16 = w24
          }
        }
      }
    }
    stop if w16
  }
  $Output <- w14
  $"aligned data" <- w15
