vi "frame_align_sp.gvi"   [LabVIEW NXG]
inputs:
  "Input": any
  "magic head": string = "VLC"
  "magic number": u32 = 449
outputs:
  "Output": any
  "aligned data": u8[]
diagram:
  String Length(string=$"magic head") -> (length=w1)
  while {
    Host Fifo Read Node[FifoName="decode fifo up"](FPGA VI Reference In=$Input, Number of Elements=$"magic number", Timeout (ms)=-1) -> (Data=w2, FPGA VI Reference Out=w3)  # Read DMA FIFO
    Type Cast(x=w2) -> w4
    String Subset(length (rest)=w1, offset (0)=0, string=w4) -> w5
    Is Equal(x=w5, y=$"magic head") -> w6
    stop if w6
  }
  $Output <- w3
  $"aligned data" <- w2
