vi "frame_chansim.gvi"   [LabVIEW NXG]
inputs:
  "Input": any
  "Loss Threshold": f64 = 0.9
  "Error Threshold": f64 = 0.7
  "magic number": u32
  "Error Number in": i32
  "Loss Number in": i32
outputs:
  "Output": any
  "Error Number out": i32
  "Loss Number out": i32
  "data out": u8[]
panel indicators:
  "random number": f64
diagram:
  Random Number() -> (number (0 to 1)=w1)
  Host Fifo Read Node[FifoName="decode fifo up"](FPGA VI Reference In=$Input, Number of Elements=$"magic number", Timeout (ms)=-1) -> (Data=w2, FPGA VI Reference Out=w3)
  Is Greater(x=w1, y=$"Error Threshold") -> w4
  case (w4) {
    frame False, Default {
      w5 = w3
      w6 = w2
      w7 = $"Error Number in"
      w8 = $"Loss Number in"
    }
    frame True {
      Is Greater(x=w1, y=$"Loss Threshold") -> w9
      case (w9) {
        frame False, Default {
          call "build_errors.gvi"(data in=w2) -> (data out=w6)
          # error
          Increment(x=$"Error Number in") -> w7
          w5 = w3
          w8 = $"Loss Number in"
        }
        frame True {
          # loss
          Increment(x=$"Loss Number in") -> w10
          call "frame_chansim.gvi"(Input=w3, Loss Threshold=$"Loss Threshold", Error Threshold=$"Error Threshold", magic number=$"magic number", Error Number in=$"Error Number in", Loss Number in=w10) -> (Output=w5, Error Number out=w7, Loss Number out=w8, data out=w6)
        }
      }
    }
  }
  $Output <- w5
  $"data out" <- w6
  $"random number" <- w1
  $"Error Number out" <- w7
  $"Loss Number out" <- w8
