vi "frame_parser.gvi"   [LabVIEW NXG]
inputs:
  "data": u8[]
  "strict mode": bool
  "magic head": string = "VLC"
outputs:
  "isAligned?": bool
  "Packet": T1
panel controls:
  "Template": T1 = {"frame type"=[FALSE, TRUE], "receiver id"=[FALSE, FALSE, FALSE]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}
types:
  T1 = cluster{"frame type": bool[], "receiver id": bool[], "RealTime?": bool, "Finished?": bool, "Flipped?": bool, "split position": u8, "data": string}
diagram:
  String Length(string=$"magic head") -> (length=w1)
  # header
  Split 1D Array(array=$data, index=w1) -> (first subarray=w2, second subarray=w3)
  w4 = 1  # offset
  w5 = 1  # flag
  Split 1D Array(array=w3, index=w5) -> (first subarray=w6, second subarray=w7)
  Split 1D Array(array=w7, index=w4) -> (first subarray=w8, second subarray=w9)
  Array Index(array=w8) -> (out0[0]=w10)
  Type Cast(x=w9) -> w11
  Array Index(array=w6) -> (out0[0]=w12)
  Number To Boolean Array(number=w12) -> (Boolean array=w13)
  w14 = 2  # frame type
  Split 1D Array(array=w13, index=w14) -> (first subarray=w15, second subarray=w16)
  w17 = 3  # receiver id
  Split 1D Array(array=w16, index=w17) -> (first subarray=w18, second subarray=w19)
  w20 = 0  # realtime?
  Array Index(array=w19) -> (out0[w20]=w21)
  w22 = 1  # finished?
  Array Index(array=w19) -> (out0[w22]=w23)
  w24 = 2  # flipped?
  Array Index(array=w19) -> (out0[w24]=w25)
  Property Node(instance in=$Template, "frame type"=w15, "receiver id"=w18, "RealTime?"=w21, "Finished?"=w23, "Flipped?"=w25, "split position"=w10, "data"=w11) -> (instance out=w26)
  case ($"strict mode") {
    frame False, Default {
      w27 = w26
      w28 = TRUE
    }
    frame True {
      Type Cast(x=w2) -> w29
      Is Equal(x=w29, y=$"magic head") -> w30
      Array Size(array=$data) -> (size(s)=w31)
      Is Equal(x=449, y=w31) -> w32
      Property Node(instance in=w26) -> (instance out=w27, "frame type"=w33, "receiver id"=w34)
      Boolean Array To Number(Boolean array=w34) -> (number=w35: u8)
      Is Equal(x=w35, y=0) -> w36
      Boolean Array To Number(Boolean array=w33) -> (number=w37: u8)
      # do check here
      Is Equal(x=1, y=w37) -> w38
      Logical And(w38, w36, w30, w32) -> w28
    }
  }
  $Packet <- w27
  $"isAligned?" <- w28
