vi "frame_reactor.gvi"   [LabVIEW NXG]
inputs:
  "Packet": T1 = {"frame type"=[FALSE, TRUE], "receiver id"=[FALSE, FALSE, FALSE]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}
  "Input": Queue<string>
  "remains in": string
  "strict mode": bool
  "status in": u8
outputs:
  "Output": Queue<string>
  "remains out": string
  "status out": u8
  "isAligned?": bool
panel indicators:
  "Packet Display": T1
  "case number": u32
types:
  T1 = cluster{"frame type": bool[], "receiver id": bool[], "RealTime?": bool, "Finished?": bool, "Flipped?": bool, "split position": u8, "data": string}
diagram:
  Property Node(instance in=$Packet) -> ("frame type"=w1, "receiver id"=w2)
  Property Node(instance in=$Packet) -> ("Flipped?"=w3, "split position"=w4, "data"=w5)
  call "build_offset.gvi"(Flipped?=w3, split position=w4, data in=w5) -> (first data=w6, first length=w7, second data=w8, second length=w9)
  Property Node(instance in=$Packet) -> ("RealTime?"=w10, "Finished?"=w11)
  Build Array(w11, w10) -> w12
  Boolean Array To Number(Boolean array=w12) -> (number=w13)
  case (w13) {
    frame 0, Default {
      case ($"strict mode") {
        frame False, Default {
          w18 = TRUE
        }
        frame True {
          Is Equal(x=$"status in", y=1) -> w19
          String Length(string=$"remains in") -> (length=w20)
          Is Not Equal To 0(x=w20) -> w21
          Is Equal To 0(x=w9) -> w22
          Logical And(w21, w19, w22) -> w18
        }
      }
      # w9: second length
      # w6: first data
      # in buffering
      case (w18) {
        frame False, Default {
          w14 = EmptyString
          w15 = w18
          w16 = 0
        }
        frame True {
          Concatenate Strings($"remains in", w6) -> w14
          w15 = w18
          w16 = 1
        }
      }
      w17 = $Input
    }
    frame 1 {
      case ($"strict mode") {
        frame False, Default {
          w23 = TRUE
        }
        frame True {
          Is Equal(x=1, y=$"status in") -> w24
          Is Empty String Or Path(string/path=$"remains in") -> w25
          Not(x=w25) -> w26
          Logical And(w24, w26) -> w27
          Is Equal To 0(x=$"status in") -> w28
          Is Equal To 0(x=w7) -> w29
          Logical And(w28, w29) -> w30
          Logical Or(w27, w30) -> w23
        }
      }
      # w8: second data
      # adjacent fragments
      case (w23) {
        frame False, Default {
          w16 = 0
          w17 = $Input
          w15 = w23
        }
        frame True {
          Is Greater Than 0(x=w7) -> w31
          case (w31) {
            frame False, Default {
              w17 = $Input
            }
            frame True {
              Concatenate Strings($"remains in", w6) -> w32
              Enqueue Element(element=w32, queue=$Input) -> (queue out=w17)
            }
          }
          w16 = 1
          w15 = w23
        }
      }
      w14 = w8
    }
    frame 2 {
      # w8: second data
      case ($"strict mode") {
        frame False, Default {
          w33 = TRUE
        }
        frame True {
          Is Equal To 0(x=$"status in") -> w34
          Is Empty String Or Path(string/path=$"remains in") -> w35
          Logical And(w34, w35) -> w33
        }
      }
      # small single packet
      case (w33) {
        frame False, Default {
          w16 = 0
          w17 = $Input
          w15 = w33
          w14 = EmptyString
        }
        frame True {
          Enqueue Element(element=w6, queue=$Input) -> (queue out=w17)
          # maybe interrupted here
          w16 = 0
          w15 = w33
          w14 = $"remains in"
        }
      }
    }
    frame 3 {
      # w8: second data
      case ($"strict mode") {
        frame False, Default {
          w36 = TRUE
        }
        frame True {
          Is Equal(x=1, y=$"status in") -> w37
          Is Empty String Or Path(string/path=$"remains in") -> w38
          Not(x=w38) -> w39
          Logical And(w37, w39) -> w36
        }
      }
      # end of fragment
      case (w36) {
        frame False, Default {
          w14 = EmptyString
          w17 = $Input
          w15 = w36
          w16 = 0
        }
        frame True {
          Concatenate Strings($"remains in", w6) -> w40
          Enqueue Element(element=w40, queue=$Input) -> (queue out=w17)
          w14 = EmptyString
          w15 = w36
          w16 = 0
        }
      }
    }
  }
  $"status out" <- w16
  $Output <- w17
  $"remains out" <- w14
  $"isAligned?" <- w15
  $"case number" <- w13
  $"Packet Display" <- $Packet
