vi "packet_assembler.gvi"   [LabVIEW NXG]
inputs:
  "magic head": string = "VLC"
  "Error Threshold": f64 = 0.7
  "Error In": error
  "FPGA.Interface": any
  "Port": u16
  "strict mode": bool
  "Loss Threshold": f64 = 0.9
outputs:
  "Error Out": error
panel controls:
  "Stop": bool
panel indicators:
  "tx loop": i32
  "output": string
  "length": i32
  "isAligned?": bool
  "status code": u8
  "remains": string
  "lose sync": i32
  "rx loop": i32
  "error delta": i32
  "loss delta": i32
diagram:
  # Parameter:
  # 	[strict mode] check packet content to judge sync status
  # 1. Sync
  # 2. fragment size == 449
  # 3. in-order packet receiving
  # 4. reassemble fragments and go
  # 5. reassemble fail, then resync (goto 1)
  sequence {
    frame 0 {
      $remains <- EmptyString
      $"isAligned?" <- FALSE
      $"lose sync" <- 0
      $"rx loop" <- 0
      Obtain Queue(element data type=string "", name (unnamed)="Cooked Data") -> (queue out=w1)
      String To Ip Address(name="127.0.0.1") -> (net address=w2)
      Udp Open(error in (no error)=$"Error In", port=11081) -> (connection ID=w3, error out=w4)
      $"tx loop" <- 0
    }
  }
  w5 = 449  # magic number
  while (iteration -> i1) {
    call "frame_align.gvi"(magic head=$"magic head", Input=$"FPGA.Interface", magic number=w5) -> (Output=w6, aligned data=w7)
    call "frame_parser.gvi"(data=w7, strict mode=$"strict mode", magic head=$"magic head") -> (Packet=w8)
    call "frame_reactor.gvi"(Packet=w8, Input=w1, remains in=EmptyString, strict mode=$"strict mode", status in=0) -> (Output=w9, remains out=w10, status out=w11)
    s1 = w10  # shift register
    s2 = w11  # shift register
    s3 = uninitialised  # shift register
    s4 = uninitialised  # shift register
    while (iteration -> i2) {
      call "frame_chansim.gvi"(Input=w6, Loss Threshold=$"Loss Threshold", Error Threshold=$"Error Threshold", magic number=w5, Error Number in=s3, Loss Number in=s4) -> (Error Number out=w12, Loss Number out=w13, data out=w14)
      Subtract(x=w12, y=s3) -> w15
      $"error delta" <- w15
      Subtract(x=w13, y=s4) -> w16
      $"loss delta" <- w16
      call "frame_parser.gvi"(data=w14, strict mode=$"strict mode", magic head=$"magic head") -> (isAligned?=w17, Packet=w18)
      call "frame_reactor.gvi"(Packet=w18, Input=w9, remains in=s1, strict mode=$"strict mode", status in=s2) -> (Output=w19, remains out=w20, status out=w21, isAligned?=w22)
      $"status code" <- w21
      $remains <- w20
      Logical And(w22, w17) -> w23
      $"isAligned?" <- w23
      $"rx loop" <- i2
      Not(x=w23) -> w24
      next s1 = w20
      next s2 = w21
      next s3 = w12
      next s4 = w13
      stop if w24
    }
    $"lose sync" <- i1
    stop if FALSE
  }
  while (iteration -> i3) {
    Dequeue Element(queue=w1) -> (element=w25)
    String Length(string=w25) -> (length=w26)
    $length <- w26
    $output <- w25
    Udp Write(address=w2, connection ID=w3, data in=w25, error in (no error)=w4, port or service name=$Port) -> (connection ID out=w27, error out=w28)
    Property Node(instance in=w28) -> (instance out=w29, "status"=w30)
    Logical Or(w30, $Stop) -> w31
    $"tx loop" <- i3
    stop if w31
  }
  Udp Close(connection ID=w27, error in (no error)=w29) -> (error out=w32)
  $"Error Out" <- w32
