vi "udp_chop.gvi"   [LabVIEW NXG]
inputs:
  "UDP Handle": UdpNetworkConnectionRefnum
  "IP Address": u32
  "Port": u16
  "Error In": error
  "FPGA.Interface": any
  "Stop": bool
  "magic head": string = "VLC"
outputs:
  "Error Out": error
  "UDP Handle Out": UdpNetworkConnectionRefnum
panel indicators:
  "number elements in queue": i32
  "output": string
  "length": i32
  "number": i32
diagram:
  Obtain Queue(element data type=u8 0, name (unnamed)="Raw Data") -> (queue out=w1)
  while {
    Host Fifo Read Node[FifoName="decode fifo up"](FPGA VI Reference In=$"FPGA.Interface", Number of Elements=0, Timeout (ms)=5000) -> (Elements Remaining=w2, Error Out=w3, FPGA VI Reference Out=w4)
    Host Fifo Read Node[FifoName="decode fifo up"](Error In=w3, FPGA VI Reference In=w4, Number of Elements=w2) -> (Data=w5, Error Out=w6)
    for {
      w7 = each element of w5
      Enqueue Element(element=w7, error in (no error)=w6, queue=w1) -> (queue out=w8)
    }
    stop if FALSE
  }
  Release Queue(queue=w8)
  String Length(string=$"magic head") -> (length=w9)
  Concatenate Strings($"magic head", ".+", $"magic head") -> w10
  Obtain Queue(element data type=u8[] [], name (unnamed)="Cooked Data") -> (queue out=w11)
  while (after w10) {
    Get Queue Status(queue=w1, return elements? (F)=TRUE) -> (# elements in queue=w12, elements=w13)
    Type Cast(type=string "", x=w13) -> w14
    Match Pattern(regular expression=$"magic head", string=w14) -> (offset past match=w15)
    Match Pattern(offset (0)=w15, regular expression=$"magic head", string=w14) -> (offset past match=w16)
    Subtract(x=w16, y=w9) -> w17
    Is Greater Or Equal To 0(x=w16) -> w18
    case (w18) {
      frame False, Default { }
      frame True {
        for (N = w17) {
          Dequeue Element(queue=w1) -> (element=w20, queue out=w21)
          append w20 to w19
        }
        Array Subset(array=w19, index0=w15) -> w22
        Enqueue Element(element=w22, queue=w11)
      }
    }
    $"number elements in queue" <- w12
    stop if FALSE
  }
  Release Queue(queue=w11)
  $number <- 0
  s1 = 0  # shift register
  while {
    Dequeue Element(queue=w11) -> (element=w23)
    Type Cast(type=string "", x=w23) -> w24
    String Length(string=w24) -> (length=w25)
    Is Less(x=w25, y=2000)
    case (TRUE) {
      frame False, Default {
        w26 = $"UDP Handle"
        w27 = $"Error In"
        w28 = s1
      }
      frame True {
        Increment(x=s1) -> w28
        $number <- w28
        $length <- w25
        $output <- w24
        Udp Write(address=$"IP Address", connection ID=$"UDP Handle", data in=w24, error in (no error)=$"Error In", port or service name=$Port) -> (connection ID out=w26, error out=w27)
      }
    }
    Property Node(instance in=w27) -> (instance out=w29, "status"=w30)
    Logical Or(w30, $Stop) -> w31
    next s1 = w28
    stop if w31
  }
  $"UDP Handle Out" <- w26
  $"Error Out" <- w29
