vi "udp_chop_ex.gvi"   [LabVIEW NXG]
inputs:
  "UDP Handle": UdpNetworkConnectionRefnum
  "magic head": string = "VLC"
  "Port": u16
  "FPGA.Interface": any
  "Error In": error
outputs:
  "UDP Handle Out": UdpNetworkConnectionRefnum
  "Error Out": error
panel controls:
  "Stop": bool
panel indicators:
  "output": string
  "length": i32
  "number": i32
  "pointer": i32
  "counter": i32
  "case": u32
  "remains": i32
diagram:
  Obtain Queue(element data type=u8 0, name (unnamed)="Raw Data") -> (queue out=w1)
  while {
    Host Fifo Read Node[FifoName="decode fifo up"](FPGA VI Reference In=$"FPGA.Interface", Number of Elements=0, Timeout (ms)=5000) -> (Elements Remaining=w2, Error Out=w3, FPGA VI Reference Out=w4)
    Host Fifo Read Node[FifoName="decode fifo up"](Error In=w3, FPGA VI Reference In=w4, Number of Elements=w2) -> (Data=w5, Error Out=w6)
    for {
      w7 = each element of w5
      Enqueue Element(element=w7, error in (no error)=w6, queue=w1) -> (queue out=w8)
    }
    stop if FALSE
  }
  Release Queue(queue=w8)
  Type Cast(type=u8[] [], x=$"magic head") -> w9
  Array Size(array=w9) -> (size(s)=w10)
  Array Index(array=w9) -> (out0[0]=w11)
  w12 = 0  # pointer
  w13 = 0  # counter
  Obtain Queue(element data type=u8[] [], name (unnamed)="Cooked Data") -> (queue out=w14)
  s1 = w13  # shift register
  s2 = w12  # shift register
  s3 = u8[] []  # shift register
  while {
    Flush Queue(queue=w1) -> (remaining elements=w15)
    Build Array[ConcatenateInputs=True](s3, w15) -> w16
    Search 1D Array(1D array=w16, element=w11, start index (0)=s2) -> (index of element=w17)
    Array Size(array=w16) -> (size(s)=w18)
    Decrement(x=w18) -> w19
    Is Less Than 0(x=w17) -> w20
    Select(s=w20, t=w19, f=w17) -> w21
    Array Subset(array=w16, index0=w21, length0=w10) -> w22
    Is Equal(x=w22, y=w9) -> w23
    Boolean To Integer(Boolean=w23) -> (0, 1=w24)
    Add Array Elements(numeric array=w24) -> (sum=w25)
    Is Equal(x=w25, y=w10) -> w26
    Is Equal(x=s1, y=1) -> w27
    Build Array(w26, w27) -> w28
    Boolean Array To Number(Boolean array=w28) -> (number=w29)
    Array Size(array=w23) -> (size(s)=w30)
    # s1: counter
    Is Equal(x=w30, y=w10) -> w31
    Boolean To Integer(Boolean=w31) -> (0, 1=w32)
    # w16: array
    case (w29) {
      frame 0, Default {
        # (pre-sync state)
        # counter==0 && not found:
        #   discard until next sync_head[0]
        Multiply(w32, w10) -> w36
        Add(w21, w36) -> w37
        Array Subset(array=w16, index0=w37) -> w35
        w33 = s1
        w34 = 0
      }
      frame 1 {
        Add(w21, w10) -> w38
        Array Subset(array=w16, index0=w38) -> w35
        # (transient state)
        # counter==0 && find next:
        #   discard those before and header
        #   and header itself
        Increment(x=s1) -> w33
        w34 = 0
      }
      frame 2 {
        # (most common case)
        # counter==1 && not found:
        #   move pointer to next magic_head[0]
        Multiply(w32, w10) -> w39
        Add(w21, w39) -> w34
        w33 = s1
        w35 = w16
      }
      frame 3 {
        # (transient state)
        # counter==1 && find next:
        #   enqueue and back to case2
        Delete From Array(inArray=w16, length (1)=w21, index0=0) -> (outArray=w40, deleted=w41)
        Delete From Array(inArray=w40, length (1)=w10, index0=0) -> w35
        Enqueue Element(element=w41, queue=w14)
        w33 = s1
        w34 = 0
      }
    }
    $remains <- w18
    $pointer <- s2
    # s2: pointer
    $counter <- s1
    $case <- w29
    next s1 = w33
    next s2 = w34
    next s3 = w35
    stop if FALSE
  }
  $number <- 0
  String To Ip Address(name="127.0.0.1") -> (net address=w42)
  s4 = 0  # shift register
  while {
    Dequeue Element(queue=w14) -> (element=w43)
    Type Cast(type=string "", x=w43) -> w44
    String Length(string=w44) -> (length=w45)
    $length <- w45
    Is Greater(x=w45, y=0) -> w46
    case (w46) {
      frame False, Default {
        w47 = $"UDP Handle"
        w48 = $"Error In"
        w49 = s4
      }
      frame True {
        Increment(x=s4) -> w49
        $number <- w49
        $output <- w44
        Udp Write(address=w42, connection ID=$"UDP Handle", data in=w44, error in (no error)=$"Error In", port or service name=$Port) -> (connection ID out=w47, error out=w48)
      }
    }
    Property Node(instance in=w48) -> (instance out=w50, "status"=w51)
    Logical Or(w51, $Stop) -> w52
    next s4 = w49
    stop if w52
  }
  $"UDP Handle Out" <- w47
  $"Error Out" <- w50
