vi "build_frags.gvi"   [LabVIEW NXG]
inputs:
  "magic number": i32
  "data in": u8[]
outputs:
  "first data": u8[]
  "frags array": u8[][]
  "last data": u8[]
diagram:
  Array Size(array=$"data in") -> (size(s)=w1)
  Quotient And Remainder(x=w1, y=$"magic number") -> (floor(x/y)=w2, x-y*floor(x/y)=w3)
  Is Equal To 0(x=w3) -> w4
  Is Greater(x=w2, y=1) -> w5
  Logical And(w4, w5) -> w6
  case (w6) {
    frame False, Default {
      Decrement(x=w2) -> w7
      w8 = w3
    }
    frame True {
      Decrement(x=w2) -> w9
      Decrement(x=w9) -> w7
      w8 = $"magic number"
    }
  }
  Delete From Array(inArray=$"data in", length (1)=w8) -> (outArray=w10, deleted=w11)
  Delete From Array(inArray=w10, length (1)=$"magic number", index0=0) -> (outArray=w12, deleted=w13)
  Reshape Array(inArray=w12, size=w7, size=$"magic number") -> w14
  $"frags array" <- w14
  $"first data" <- w13
  $"last data" <- w11
