vi "build_packet.gvi"   [LabVIEW NXG]
inputs:
  "Template": T1 = {"frame type"=[FALSE, TRUE], "receiver id"=[FALSE, FALSE, FALSE]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}
  "data in": u8[]
  "Input": Queue<u8[]>
outputs:
  "data out": u8[]
  "Output": Queue<u8[]>
types:
  T1 = cluster{"Sync Header": u8[], "frame type": bool[], "receiver id": bool[], "RealTime?": bool, "Finished?": bool, "Flipped?": bool, "split position": u8}
diagram:
  Property Node(instance in=$Template) -> ("Sync Header"=w1, "frame type"=w2, "receiver id"=w3, "RealTime?"=w4, "Finished?"=w5, "Flipped?"=w6, "split position"=w7)
  Build Array[ConcatenateInputs=True](w2, w3, w4, w5, w6) -> w8
  Boolean Array To Number(Boolean array=w8) -> (number=w9: u8)
  Build Array[ConcatenateInputs=True](w1, w9, w7, $"data in") -> w10
  Enqueue Element(element=w10, queue=$Input) -> (queue out=w11)
  $Output <- w11
  $"data out" <- w10
