vi "flip_sign.gvi"   [LabVIEW NXG]
inputs:
  "size": i32
  "magic number": i32
outputs:
  "output": u8
  "flipped?": bool
diagram:
  Is Greater(x=$size, y=255) -> w1
  $"flipped?" <- w1
  Subtract(x=$"magic number", y=$size) -> w2
  Select(s=w1, t=w2, f=$size) -> w3
  $output <- w3
