vi "frame_generator.gvi"   [LabVIEW NXG]
inputs:
  "error in": error
  "Template": T1 = {"frame type"=[FALSE, TRUE], "receiver id"=[FALSE, FALSE, FALSE]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}
  "pre buffer": Queue<u8[]>
  "post buffer": Queue<u8[]>
outputs:
  "error out": error
panel controls:
  "Stop": bool
panel indicators:
  "data size": i32
  "Output Data": string
  "Length": i32
  "loop iteration": i32
  "remains": i32
  "Sync LED": bool
  "cluster out": T1
types:
  T1 = cluster{"Sync Header": u8[], "frame type": bool[], "receiver id": bool[], "RealTime?": bool, "Finished?": bool, "Flipped?": bool, "split position": u8}
diagram:
  Property Node(instance in=$Template) -> (instance out=w1, "Sync Header"=w2)
  w3 = 449  # magic number
  w4 = 2  # header size
  Subtract(x=w3, y=w4) -> w5
  Array Size(array=w2) -> (size(s)=w6)
  Subtract(x=w5, y=w6) -> w7
  w8 = u8[] []  # last remains
  s1 = w8  # shift register
  while (iteration -> i1) {
    Dequeue Element(queue=$"pre buffer") -> (element=w9, queue out=w10)
    Array Size(array=w9) -> (size(s)=w11)
    Is Less Or Equal(x=w11, y=w7) -> w12
    case (w12) {
      frame False, Default {
        Preview Queue Element(queue=w10, timeout in ms (-1)=0) -> (element=w14)
        Array Size(array=w14) -> (size(s)=w15)
        Is Less Or Equal(x=w15, y=w7) -> w16
        Build Array[ConcatenateInputs=True](s1, w9) -> w17
        call "build_frags.gvi"(magic number=w7, data in=w17) -> (first data=w18, frags array=w19, last data=w20)
        Is Empty Array(array=w20) -> w21
        Not(x=w21) -> w22
        Logical And(w16, w22) -> w23
        Array Size(array=s1) -> (size(s)=w24)
        call "flip_sign.gvi"(size=w24, magic number=w7) -> (output=w25, flipped?=w26)
        Property Node(instance in=w1, "RealTime?"=FALSE, "Finished?"=TRUE, "Flipped?"=w26, "split position"=w25) -> (instance out=w27)
        call "build_packet.gvi"(Template=w27, data in=w18, Input=$"post buffer") -> (Output=w28)
        for {
          w29 = each element of w19
          Property Node(instance in=w27, "RealTime?"=FALSE, "Finished?"=FALSE, "Flipped?"=TRUE, "split position"=0) -> (instance out=w30)
          call "build_packet.gvi"(Template=w30, data in=w29, Input=w28) -> (data out=w31)
          Array Size(array=w31) -> (size(s)=w32)
          $Length <- w32
          Type Cast(x=w31) -> w33
          $"Output Data" <- w33
        }
        case (w23) {
          frame True {
            Array Size(array=w20) -> (size(s)=w34)
            call "flip_sign.gvi"(size=w34, magic number=w7) -> (output=w35, flipped?=w36)
            Property Node(instance in=w1, "RealTime?"=TRUE, "Finished?"=TRUE, "Flipped?"=w36, "split position"=w35) -> (instance out=w37)
            $"cluster out" <- w37
            Subtract(x=w7, y=w34) -> w38
            Initialize Array(element=0, size=w38) -> w39
            Build Array[ConcatenateInputs=True](w20, w39) -> w40
            call "build_packet.gvi"(Template=w37, data in=w40, Input=w28) -> (data out=w41)
            Array Size(array=w41) -> (size(s)=w42)
            $Length <- w42
            Type Cast(x=w41) -> w43
            $"Output Data" <- w43
            $"Sync LED" <- TRUE
            w13 = default
          }
          frame False {
            # has next
            w13 = w20
          }
        }
      }
      frame True {
        call "flip_sign.gvi"(size=w11, magic number=w7) -> (output=w44, flipped?=w45)
        # small packet
        Property Node(instance in=w1, "RealTime?"=TRUE, "Finished?"=FALSE, "Flipped?"=w45, "split position"=w44) -> (instance out=w46)
        Subtract(x=w7, y=w11) -> w47
        Initialize Array(element=0, size=w47) -> w48
        Build Array[ConcatenateInputs=True](w9, w48) -> w49
        call "build_packet.gvi"(Template=w46, data in=w49, Input=$"post buffer") -> (data out=w50)
        Array Size(array=w50) -> (size(s)=w51)
        $Length <- w51
        Type Cast(x=w50) -> w52
        $"Output Data" <- w52
        w13 = s1
      }
    }
    Array Size(array=s1) -> (size(s)=w53)
    $remains <- w53
    $"loop iteration" <- i1
    next s1 = w13
    stop if $Stop
  }
  $"data size" <- w7
  $"Output Data" <- EmptyString
  $Length <- 0
  $"error out" <- $"error in"
  $"Sync LED" <- FALSE
